# Grasshopper definition HoneycombConvert_8.gh (Grasshopper 0.9.80)
# plug-ins: LunchBox, MetaHopper

battery_connector = Button()
full_color_led = Button()
cross_cell_circuit_connector = Button()
touch_sensor = Button()
create_component = Button()
cross_cell_circuit_connector_2 = Button()
export = Button()
photo_sensor = Button()
led = Button()
set_model_data = Button()
number_slider = Slider(6, range=0..30)  # "1D/2D"
bake = BakeObject(Bake=export, AllObjects_Object=move_11)
filter = StreamFilter(Gate=full_color_led, Stream1="3")
filter_2 = StreamFilter(Gate=led, Stream1="1")
filter_3 = StreamFilter(Gate=photo_sensor, Stream1="2")
filter_4 = StreamFilter(Gate=touch_sensor, Stream1="4")
rec = DataRecorder([filter_2, filter_3, filter, filter_4], DataLimit=1, RecordData=True)
panel = Panel(rec)
# Set a model
brep = Brep(<brep referenced from the Rhino model>)
filter_5 = StreamFilter(Gate=panel, Stream1="3,5,2", Stream2="3,2,2", Stream3="3,5,3", Stream4="1,5,2")
layer_ref = LayerReference(ReferenceToggle=Toggle(True), LayerName="model")  # -> Geometry, Name, UserStrings, GUID
pdecon = Deconstruct(Point=filter_5)  # -> XComponent, YComponent, ZComponent
debox = DeconstructBox(Box=brep)  # -> Plane, X, Y, Z

convert_honeycomb = BooleanToggle(True)
onoff = EnableDisableObject(Enabled=convert_honeycomb, AllObjects_Object=movetoplane)

width_of_the_cell_mm = Slider(5.1, range=1..11)

dedomain = DeconstructDomain(Domain=debox.Y)  # -> Start, End
dedomain_2 = DeconstructDomain(Domain=debox.X)  # -> Start, End
addition = Addition(A=width_of_the_cell_mm, B=dedomain_2.Start)
vec = VectorXYZ(XComponent=dedomain_2.Start, YComponent=dedomain.Start, ZComponent=0)  # -> Vector, Length
vec_2 = VectorXYZ(XComponent=addition, YComponent=dedomain.Start, ZComponent=0)  # -> Vector, Length
aligndim = AlignedDimension(Plane=PlaneXY(0, 0, 0), PointA=vec.Vector, PointB=vec_2.Vector, Offset="-3", Text="{0:0.00}", Size=1)

dedomain_3 = DeconstructDomain(Domain=debox.Y)  # -> Start, End
dedomain_4 = DeconstructDomain(Domain=debox.X)  # -> Start, End
addition_2 = Addition(A=dedomain_3.Start, B=width_of_the_cell_mm)
addition_3 = Addition(A=addition_2, B=width_of_the_cell_mm)
vec_3 = VectorXYZ(XComponent=dedomain_4.Start, YComponent=addition_2, ZComponent=0)  # -> Vector, Length
vec_4 = VectorXYZ(XComponent=dedomain_4.Start, YComponent=addition_3, ZComponent=0)  # -> Vector, Length
aligndim_2 = AlignedDimension(Plane=PlaneXY(0, 0, 0), PointA=vec_3.Vector, PointB=vec_4.Vector, Offset=1, Text="{0:0.00}", Size=1)

brep_2 = Brep(<brep referenced from the Rhino model>)
num = Number(debox.Y)
num_2 = Number(debox.X)
onoff_2 = EnableDisableObject(Enabled=convert_honeycomb, AllObjects_Object=extr_2)
neg = Negative(Value=convert_honeycomb)
dedomain_5 = DeconstructDomain(Domain=debox.X)  # -> Start, End
dedomain_6 = DeconstructDomain(Domain=debox.Y)  # -> Start, End
addition_4 = Addition(A=neg, B="1")
division = Division(A=num, B=width_of_the_cell_mm)
X = UnitX(Factor=dedomain_5.Start)
hideshow = HideShowObjectPreview(Visible=addition_4, AllObjects_Object=layer_ref)
area = Area(Geometry=brep_2)  # -> Area, Centroid
division_2 = Division(A=num, B=division)
debox_2 = DeconstructBox(Box=brep_2)  # -> Plane, X, Y, Z
division_3 = Division(A=num_2, B=width_of_the_cell_mm)

dedomain_7 = DeconstructDomain(Domain=debox.Y)  # -> Start, End
dedomain_8 = DeconstructDomain(Domain=debox.X)  # -> Start, End
num_3 = Number(width_of_the_cell_mm)
multiplication = Multiplication(A="2", B=num_3)
addition_5 = Addition(A=dedomain_7.Start, B=multiplication)
addition_6 = Addition(A=dedomain_7.Start, B=num_3)
pt = ConstructPoint(XCoordinate=dedomain_8.Start, YCoordinate=addition_6, ZCoordinate=0)
pt_2 = ConstructPoint(XCoordinate=dedomain_8.End, YCoordinate=addition_5, ZCoordinate=0)
box = Box2Pt(PointA=pt, PointB=pt_2, Plane=PlaneXY(0, 0, 0))
multiplication_2 = Multiplication(A="4", B=num_3)
Y = UnitY(Factor=multiplication_2)
division_4 = Division(A=division, B="4")
arrlinear = LinearArray(Geometry=box, Direction=Y, Count=division_4)  # -> Geometry, Transform
preview = CustomPreview(Geometry=arrlinear.Geometry, Shader=ColourSwatch(SwatchColor=RGB(2, 237, 190)))

# ---- group: limit of size of Y cell from height of components
selobj = GetSelectedObjects()  # -> ComponentObjects, ParamObjects, OtherObjects
dom = ConstructDomain(DomainStart=debox_2.Y, DomainEnd="10")
set_slider = SetSliderProperties(Slider=selobj.ParamObjects, Range=dom)

# ----
box_2 = DomainBox(Base=PlaneXY(0, 0, 0), X=pdecon.XComponent, Y=pdecon.YComponent, Z=pdecon.ZComponent)
y = Panel(division_2)
move = Move(Geometry=box_2, Motion=area.Centroid)  # -> Geometry, Transform
movetoplane = MoveToPlane(Geometry=brep, Plane=PlaneXY(0, 0, 0), Above=True, Below=True)  # -> Geometry, Transform
dedomain_9 = DeconstructDomain(Domain=debox.Y)  # -> Start, End
pt_3 = ConstructPoint(XCoordinate="0", YCoordinate=dedomain_9.Start, ZCoordinate="0")
pt_4 = ConstructPoint(XCoordinate="0", YCoordinate=dedomain_9.Start, ZCoordinate="1000")

# ---- group: X slices >lines
Y_2 = UnitY(Factor=width_of_the_cell_mm)
ln = Line(StartPoint=pt_3, EndPoint=pt_4)
arrlinear_2 = LinearArray(Geometry=ln, Direction=Y_2, Count=division)  # -> Geometry, Transform

# ----
smaller = SmallerThan(FirstNumber=width_of_the_cell_mm, SecondNumber=pdecon.XComponent)  # -> SmallerThan, OrEqualTo
smaller_2 = SmallerThan(FirstNumber=width_of_the_cell_mm, SecondNumber=pdecon.YComponent)  # -> SmallerThan, OrEqualTo
addition_7 = Addition(A=division_3, B="1")

# ---- group: Display Honey Comb
addition_8 = Addition(A=division, B="1")
series = Series(Start=dedomain_6.Start, Step=division_2, Count=addition_8)
series_x = Series(Start=dedomain_5.Start, Step=width_of_the_cell_mm, Count=addition_7)
Z = UnitZ(Factor="100")
c_script = CSharpScript(x=series, y=series_x)  # -> out, A; inputs x: list of Double, y: list of Double
# ---------- c_script: C# ----------
                                                    List<double> list1 = new List<double>();
List<double> list2 = new List<double>();
List<Line> lines = new List<Line>();

double sum = 0;
int number = 0;
list1 = x;
list2 = y;
//Print(Convert.ToSingle(list1.Count).ToString());


for (int h = 0; h < list2.Count-1; h++)
{
for (int w = 0; w < list1.Count-1; w++)
{
double v1x = 0;
double v1y = 0;
double v2x = 0;
double v2y = 0;
//if(h%2 == 0){

double list2h1 = list2[h]+(list2[h+1]-list2[h])/2;

if(w%4 == 0){
 v1x = list1[w];v1y = list2h1;v2x = list1[w+1];v2y = list2[h];
}
if(w%4 == 1){
 v1x = list1[w];v1y = list2[h];v2x = list1[w+1];v2y = list2[h];
}
if(w%4 == 2){
 v1x = list1[w];v1y = list2[h];v2x = list1[w+1];v2y = list2h1;
}
if(w%4 == 3){
 v1x = list1[w];v1y = list2h1;v2x = list1[w+1];v2y = list2h1;
}

Point3d p1 = new Point3d(v1y,v1x,0);
Point3d p2 = new Point3d(v2y,v2x,0);

Line l1 = new Line(p1,p2);
lines.Add(l1);

//}else{
if(w%4 == 0){
 v1x = list1[w];v1y = list2h1;v2x = list1[w+1];v2y = list2[h+1];
}
if(w%4 == 1){
 v1x = list1[w];v1y = list2[h+1];v2x = list1[w+1];v2y = list2[h+1];
}
if(w%4 == 2){
 v1x = list1[w];v1y = list2[h+1];v2x = list1[w+1];v2y = list2h1;
}
if(w%4 == 3){
 v1x = list1[w];v1y = list2h1;v2x = list1[w+1];v2y = list2h1;
}

//}

Point3d p3 = new Point3d(v1y,v1x,0);
Point3d p4 = new Point3d(v2y,v2x,0);

Line l2 = new Line(p3,p4);
lines.Add(l2);
}
}
A = lines;
# ---------- end c_script ----------
extr = Extrude(Base=c_script.A, Direction=Z)
X_2 = UnitX(Factor=1)
extr_2 = Extrude(Base=extr, Direction=X_2)
brep_3 = Brep(movetoplane.Geometry)
sint = SolidIntersection(BrepsA=extr_2, BrepsB=brep_3)

# ----
or = GateOr(A=smaller.SmallerThan, B=smaller_2.SmallerThan)
preview_2 = CustomPreview(Geometry=sint, Shader=ColourSwatch(SwatchColor=RGBA(255, 0, 0, 98)))
filter_6 = StreamFilter(Gate=or, Stream1="> !!!****** Change the resolution. ******!!!")
filter_7 = StreamFilter(Gate=or, Stream0=panel, Stream1="0")
yz = YZPlane(Origin=Point(0, 0, 0))
xy = XYPlane(Origin=Point(0, 0, 0))
panel_2 = Panel(filter_6)
X_3 = UnitX(Factor="0.1")
Y_3 = UnitY(Factor="1")
filter_8 = StreamFilter(
    Gate=filter_7,
    Stream0=ColourSwatch(SwatchColor=RGB(0, 0, 0)),
    Stream1=ColourSwatch(SwatchColor=RGB(255, 0, 0)),
    Stream2=ColourSwatch(SwatchColor=RGB(30, 255, 0)),
    Stream3=ColourSwatch(SwatchColor=RGB(255, 0, 212)),
    Stream4=ColourSwatch(SwatchColor=RGB(217, 255, 0)))
brep_4 = Brep(reverse([<brep referenced from the Rhino model> x2]))
preview_3 = CustomPreview(Geometry=brep_4, Shader=ColourSwatch(SwatchColor=RGB(0, 0, 0)))
series_2 = Series(Start="0", Step="4", Count=10)
series_3 = Series(Start="2", Step="4", Count=10)
item = ListItem(List=arrlinear_2.Geometry, Index=series_2, Wrap=True)
item_2 = ListItem(List=arrlinear_2.Geometry, Index=series_3, Wrap=True)
runion = RegionUnion()
bbx = BrepBrep(BrepA=runion)  # -> Curves, Points
srfsplit = SurfaceSplit(Surface=runion, Curves=bbx.Curves)
srfsplit_2 = SurfaceSplit(Surface=srfsplit)
crv = Curve(srfsplit_2)
preview_4 = CustomPreview(Geometry=crv, Shader=ColourSwatch(SwatchColor=RGB(0, 34, 255)))
xz = XZPlane(Origin=Point(0, 0, 0))
rad = Radians(Degrees="-90")

# ---- group: Y slices > planes
slicing_plate = Brep(<brep referenced from the Rhino model>)
X_4 = UnitX(Factor=width_of_the_cell_mm)

# ----
move_2 = Move(Geometry=slicing_plate, Motion=X)  # -> Geometry, Transform

# ---- group: Y slices > planes (continued)
arrlinear_3 = LinearArray(Geometry=move_2.Geometry, Direction=X_4, Count=division_3)  # -> Geometry, Transform

# ----
bbx_2 = BrepBrep(BrepA=movetoplane.Geometry, BrepB=arrlinear_3.Geometry)  # -> Curves, Points
crv_2 = Curve(bbx_2.Curves)
flatten = FlattenTree(Tree=crv_2, Path="{0}")
bbox = BoundingBox(Content=flatten, Plane=PlaneXY(0, 0, 0))  # -> Box, Box_2
debox_3 = DeconstructBox(Box=bbox.Box)  # -> Plane, X, Y, Z
Z_2 = UnitZ(Factor=debox_3.Z)
panel_3 = Panel(Z_2)
devec = DeconstructVector(Vector=Z_2)  # -> XComponent, YComponent, ZComponent
panel_4 = Panel(devec.ZComponent)
boundary = BoundarySurfaces(Edges=flatten)
movetoplane_2 = MoveToPlane(Geometry=boundary, Plane=yz, Above=True, Below=True)  # -> Geometry, Transform

# ---- group: TOP LAYER
c_script_2 = CSharpScript(x=devec.ZComponent)  # -> out, A; inputs x: list of String
# ---------- c_script_2: C# ----------
                                List<string> list = new List<string>();
List<string> list2 = new List<string>();

double sum = 0;
list = x;
list2 = x;
for (int i = 0; i < list.Count-1; i++)
{
//if(Convert.ToSingle(list[i]) != Convert.ToSingle(list[i+1])){
sum = sum + Convert.ToSingle(list[i])+Convert.ToSingle(list[i+1]);
//}
Print(Convert.ToSingle(list[i]).ToString());
//Print(sum.ToSingle());

//list2[i] = Convert.ToString(sum);
//Print(list[i].ToString());
list[i]=sum.ToString();
}
list.Insert(0,"0.0");
//list.Insert(0,x[0]);
//Print(x[0].ToString());


double t = Convert.ToDouble(list[2]);
//Print(t.ToString());
double[] array = new double[list.Count];
for (int i = 0; i < array.Length; i++)
{
array[i] = Convert.ToSingle(list[i]);
//Print(array[i].ToString());

}

for (int i = 1; i < list2.Count; i++)
{
list2[i] = list[i];
//Print(list2[i].ToString());

}
list2.RemoveAt(list2.Count-1);
A = list2;
# ---------- c_script_2: C# additional code ----------
  /// <summary>
  /// This method will be called once every solution, before any calls to RunScript.
  /// </summary>
  public override void BeforeRunScript()
  { }
  /// <summary>
  /// This method will be called once every solution, after any calls to RunScript.
  /// </summary>
  public override void AfterRunScript()
  { }
# ---------- end c_script_2 ----------
Z_3 = UnitZ(Factor=c_script_2.A)
mirror = Mirror(Geometry=movetoplane_2.Geometry, Plane=xy)  # -> Geometry, Transform
move_3 = Move(Geometry=mirror.Geometry, Motion=Z_3)  # -> Geometry, Transform

# ---- group: BOTTOM LAYER
c_script_3 = CSharpScript(x=devec.ZComponent)  # -> out, A; inputs x: list of String
# ---------- c_script_3: C# ----------
                                                                        List<string> list = new List<string>();
List<string> list2 = new List<string>();

double sum = 0;
list = x;
list2 = x;
for (int i = 0; i < list.Count-1; i++)
{
//if(Convert.ToSingle(list[i]) != Convert.ToSingle(list[i+1])){

sum = sum + Convert.ToSingle(list[i])+Convert.ToSingle(list[i+1]);
//}


//list2[i] = Convert.ToString(sum);
//Print(list[i].ToString());
list[i]=sum.ToString();
}
list.Insert(0,"0.0");
//list.Insert(0,x[0]);
//Print(x[0].ToString());


double t = Convert.ToSingle(list[2]);
//Print(t.ToString());
double[] array = new double[list.Count];
for (int i = 0; i < array.Length; i++)
{
array[i] = Convert.ToSingle(list[i]);
Print(array[i].ToString());

}

for (int i = 1; i < list2.Count; i++)
{
list2[i] = list[i];
//Print(list2[i].ToString());

}
list2.RemoveAt(list2.Count-1);
A = list2;
# ---------- end c_script_3 ----------
Z_4 = UnitZ(Factor=c_script_3.A)
move_4 = Move(Geometry=movetoplane_2.Geometry, Motion=Z_4)  # -> Geometry, Transform

# ---- group: replace components to cut data
area_2 = Area(Geometry=move.Geometry)  # -> Area, Centroid
brep_cp = BrepClosestPoint(Point=area_2.Centroid, Brep=arrlinear_3.Geometry)  # -> Point, Normal, Distance
lng = ListLength(List=arrlinear_3.Geometry)
series_4 = Series(Start="0", Step="1", Count=lng)
sort = SortList(Keys=brep_cp.Distance, ValuesA=series_4)  # -> Keys, ValuesA
item_3 = ListItem(List=sort.ValuesA, Index="0", Wrap=True)
devec_2 = DeconstructVector(Vector=area_2.Centroid)  # -> XComponent, YComponent, ZComponent
item_4 = ListItem(List=c_script_3.A, Index=item_3, Wrap=True)
multiplication_3 = Multiplication(A=devec_2.XComponent, B="-1")
vec_5 = VectorXYZ(XComponent=multiplication_3, YComponent=0, ZComponent=item_4)  # -> Vector, Length
move_5 = Move(Geometry=move.Geometry, Motion=vec_5.Vector)  # -> Geometry, Transform

# ----
srfsplit_3 = SurfaceSplit(Surface=move_3.Geometry, Curves=arrlinear_2.Geometry)

srfsplit_4 = SurfaceSplit(Surface=move_4.Geometry, Curves=arrlinear_2.Geometry)
area_3 = Area(Geometry=srfsplit_4)  # -> Area, Centroid
devec_3 = DeconstructVector(Vector=area_3.Centroid)  # -> XComponent, YComponent, ZComponent
division_5 = Division(A=division, B="4")
sort_2 = SortList(Keys=devec_3.YComponent, ValuesA=srfsplit_4)  # -> Keys, ValuesA
series_5 = Series(Start=0, Step="4", Count=division_5)
item_5 = ListItem(List=sort_2.ValuesA, Index=series_5, Wrap=True)

simplify = SimplifyTree(Tree=[srfsplit_3, srfsplit_4], Front=False)

area_4 = Area(Geometry=srfsplit_3)  # -> Area, Centroid
devec_4 = DeconstructVector(Vector=area_4.Centroid)  # -> XComponent, YComponent, ZComponent
division_6 = Division(A=division, B="4")
sort_3 = SortList(Keys=devec_4.YComponent, ValuesA=srfsplit_3)  # -> Keys, ValuesA
series_6 = Series(Start="2", Step="4", Count=division_6)
item_6 = ListItem(List=sort_3.ValuesA, Index=series_6, Wrap=True)

boundary_2 = BoundarySurfaces(Edges=simplify)

# ---- group: relocate components
brep_5 = Brep(<brep referenced from the Rhino model>)
area_5 = Area(Geometry=brep_5)  # -> Area, Centroid
srf_cp = SurfaceClosestPoint(Point=area_5.Centroid, Surface=move_4.Geometry)  # -> Point, UVPoint, Distance; disabled
sort_4 = SortList(Keys=srf_cp.Distance, ValuesA=srf_cp.Point)  # -> Keys, ValuesA
crv_cp = CurveClosestPoint(Point=area_5.Centroid, Curve=item_2)  # -> Point, Parameter, Distance; disabled
item_7 = ListItem(List=sort_4.ValuesA, Index="0", Wrap=True)
sort_5 = SortList(Keys=crv_cp.Distance, ValuesA=crv_cp.Point)  # -> Keys, ValuesA
pt_5 = Point(item_7)
item_8 = ListItem(List=sort_5.ValuesA, Index="0", Wrap=True)
subtraction = Subtraction(A=area_5.Centroid, B=pt_5)
pdecon_2 = Deconstruct(Point=subtraction)  # -> XComponent, YComponent, ZComponent
pt_6 = Point(item_8)
pdecon_3 = Deconstruct(Point=pt_6)  # -> XComponent, YComponent, ZComponent
addition_9 = Addition(A=pdecon_3.ZComponent, B=pdecon_2.ZComponent)
vec_6 = VectorXYZ(XComponent=pdecon_3.XComponent, YComponent=pdecon_3.YComponent, ZComponent=addition_9)  # -> Vector, Length
vec2pt = Vector2Pt(PointA=area_5.Centroid, PointB=vec_6.Vector, Unitize=False)  # -> Vector, Length
move_6 = Move(Geometry=brep_5, Motion=vec2pt.Vector)  # -> Geometry, Transform

# ---- group: move Y 200
Y_4 = UnitY(Factor="60")
move_7 = Move(Geometry=boundary_2, Motion=Y_4)  # -> Geometry, Transform

# ----
crv_3 = Curve(move_7.Geometry)
rotate = Rotate(Geometry=crv_3, Angle=rad, Plane=xz)  # -> Geometry, Transform
# bake this
geo = Geometry(rotate.Geometry)

# ---- group: limit positions of componens
pdecon_4 = Deconstruct(Point=area_2.Centroid)  # -> XComponent, YComponent, ZComponent
c_script_4 = CSharpScript(x=series_x, y=series, z=pdecon_4.XComponent, u=pdecon_4.YComponent)  # -> out, A, B; inputs x: list of Double, y: list of Double, z: Double, u: Double
# ---------- c_script_4: C# ----------
                        List<double> list1 = new List<double>();
List<double> list2 = new List<double>();
double CX = new double();
double CY = new double();
double RCX = new double();
double RCY = new double();

list1 = x;
list2 = y;
CX = z;
CY = u;
RCX =0;RCY =0;


for (int h = 0; h < list2.Count-4; h=h+4)
{
//double list2h1 = list2[h]+(list2[h+1]-list2[h])/2;

for (int w = 0; w < list1.Count-1; w++)
{

if( list1[w] < CX && CX < list1[w+1] ){
if( list2[h] < CY && CY < list2[h+4] ){
//if(h%4 == 0){
RCX = list1[w]; RCY = list2[h+1];
//}
}
}

}
}

A = RCX;
B = RCY;
# ---------- end c_script_4 ----------
addition_10 = Addition(A=c_script_4.B, B="2")
addition_11 = Addition(A=c_script_4.A, B="2")
vec_7 = VectorXYZ(XComponent=addition_11, YComponent=addition_10, ZComponent=pdecon_4.ZComponent)  # -> Vector, Length
vec2pt_2 = Vector2Pt(PointA=area_2.Centroid, PointB=vec_7.Vector, Unitize=False)  # -> Vector, Length
move_8 = Move(Geometry=move.Geometry, Motion=vec2pt_2.Vector)  # -> Geometry, Transform
shapein = ShapeInBrep(Brep=movetoplane.Geometry, Shape=move_8.Geometry)

# ----
c_script_5 = CSharpScript(x=shapein)  # -> out, A; inputs x: Int32, y: list of Double
# ---------- c_script_5: C# ----------
        int val = x;
//Print(Convert.ToSingle(list1.Count).ToString());
if(val > 1){val = 1;}
else{val=0;}

A = val;
# ---------- end c_script_5 ----------
panel_5 = Panel(c_script_5.A)

# ---- group: limit positions of componens (continued)
origin = StreamFilter(Gate=c_script_5.A, Stream0=vec_7.Vector, Stream1="0,0,0")
vec2pt_3 = Vector2Pt(PointA=vec_7.Vector, PointB=origin, Unitize=False)  # -> Vector, Length
move_9 = Move(Geometry=move_8.Geometry, Motion=vec2pt_3.Vector)  # -> Geometry, Transform

# ----
move_10 = Move(Geometry=move_9.Geometry, Motion=X_3)  # -> Geometry, Transform
move_11 = Move(Geometry=move_10.Geometry, Motion=Y_3)  # -> Geometry, Transform

# ---- group: limit positions of componens (continued)
preview_5 = CustomPreview(Geometry=move_11.Geometry, Shader=filter_8)
